# Grasshopper definition UpwardsRotationAnimation.gh (Grasshopper 1.0.7)
# plug-ins: V-Ray For Grasshopper 6

mtl_name = VRayMaterialFromProject(
    "/Bridge Mat",
    Has_Extract_Parameter=True,
    Has_Manage_Collection=False,
    OptionsLength=12,
    Version=1,
    Options=["/Bridge Mat", "/Glass Mat", "/Grass Mat", "/Inside Grass Mat", "/Main Mat", "/Metal Mat", "/Outside Grass Mat", "/Protector Mat", "/Rail Support Mat", "/Railing Mat", "/Trim Mat", "/Water Mat"])
mtl_name_2 = VRayMaterialFromProject(
    "/Glass Mat",
    Has_Extract_Parameter=True,
    Has_Manage_Collection=False,
    OptionsLength=12,
    Version=1,
    Options=["/Bridge Mat", "/Glass Mat", "/Grass Mat", "/Inside Grass Mat", "/Main Mat", "/Metal Mat", "/Outside Grass Mat", "/Protector Mat", "/Rail Support Mat", "/Railing Mat", "/Trim Mat", "/Water Mat"])
mtl_name_3 = VRayMaterialFromProject(
    "/Inside Grass Mat",
    Has_Extract_Parameter=True,
    Has_Manage_Collection=False,
    OptionsLength=12,
    Version=1,
    Options=["/Bridge Mat", "/Glass Mat", "/Grass Mat", "/Inside Grass Mat", "/Main Mat", "/Metal Mat", "/Outside Grass Mat", "/Protector Mat", "/Rail Support Mat", "/Railing Mat", "/Trim Mat", "/Water Mat"])
mtl_name_4 = VRayMaterialFromProject(
    "/Main Mat",
    Has_Extract_Parameter=True,
    Has_Manage_Collection=False,
    OptionsLength=12,
    Version=1,
    Options=["/Bridge Mat", "/Glass Mat", "/Grass Mat", "/Inside Grass Mat", "/Main Mat", "/Metal Mat", "/Outside Grass Mat", "/Protector Mat", "/Rail Support Mat", "/Railing Mat", "/Trim Mat", "/Water Mat"])
mtl_name_5 = VRayMaterialFromProject(
    "/Metal Mat",
    Has_Extract_Parameter=True,
    Has_Manage_Collection=False,
    OptionsLength=12,
    Version=1,
    Options=["/Bridge Mat", "/Glass Mat", "/Grass Mat", "/Inside Grass Mat", "/Main Mat", "/Metal Mat", "/Outside Grass Mat", "/Protector Mat", "/Rail Support Mat", "/Railing Mat", "/Trim Mat", "/Water Mat"])
mtl_name_6 = VRayMaterialFromProject(
    "/Outside Grass Mat",
    Has_Extract_Parameter=True,
    Has_Manage_Collection=False,
    OptionsLength=12,
    Version=1,
    Options=["/Bridge Mat", "/Glass Mat", "/Grass Mat", "/Inside Grass Mat", "/Main Mat", "/Metal Mat", "/Outside Grass Mat", "/Protector Mat", "/Rail Support Mat", "/Railing Mat", "/Trim Mat", "/Water Mat"])
mtl_name_7 = VRayMaterialFromProject(
    "/Protector Mat",
    Has_Extract_Parameter=True,
    Has_Manage_Collection=False,
    OptionsLength=12,
    Version=1,
    Options=["/Bridge Mat", "/Glass Mat", "/Grass Mat", "/Inside Grass Mat", "/Main Mat", "/Metal Mat", "/Outside Grass Mat", "/Protector Mat", "/Rail Support Mat", "/Railing Mat", "/Trim Mat", "/Water Mat"])
mtl_name_8 = VRayMaterialFromProject(
    "/Rail Support Mat",
    Has_Extract_Parameter=True,
    Has_Manage_Collection=False,
    OptionsLength=12,
    Version=1,
    Options=["/Bridge Mat", "/Glass Mat", "/Grass Mat", "/Inside Grass Mat", "/Main Mat", "/Metal Mat", "/Outside Grass Mat", "/Protector Mat", "/Rail Support Mat", "/Railing Mat", "/Trim Mat", "/Water Mat"])
mtl_name_9 = VRayMaterialFromProject(
    "/Railing Mat",
    Has_Extract_Parameter=True,
    Has_Manage_Collection=False,
    OptionsLength=12,
    Version=1,
    Options=["/Bridge Mat", "/Glass Mat", "/Grass Mat", "/Inside Grass Mat", "/Main Mat", "/Metal Mat", "/Outside Grass Mat", "/Protector Mat", "/Rail Support Mat", "/Railing Mat", "/Trim Mat", "/Water Mat"])
mtl_name_10 = VRayMaterialFromProject(
    "/Trim Mat",
    Has_Extract_Parameter=True,
    Has_Manage_Collection=False,
    OptionsLength=12,
    Version=1,
    Options=["/Bridge Mat", "/Glass Mat", "/Grass Mat", "/Inside Grass Mat", "/Main Mat", "/Metal Mat", "/Outside Grass Mat", "/Protector Mat", "/Rail Support Mat", "/Railing Mat", "/Trim Mat", "/Water Mat"])
mtl_name_11 = VRayMaterialFromProject(
    "/Water Mat",
    Has_Extract_Parameter=True,
    Has_Manage_Collection=False,
    OptionsLength=12,
    Version=1,
    Options=["/Bridge Mat", "/Glass Mat", "/Grass Mat", "/Inside Grass Mat", "/Main Mat", "/Metal Mat", "/Outside Grass Mat", "/Protector Mat", "/Rail Support Mat", "/Railing Mat", "/Trim Mat", "/Water Mat"])
geo = Geometry(<brep referenced from the Rhino model>)
geo_2 = Geometry([<brep referenced from the Rhino model> x56, <curve referenced from the Rhino model> x2, <brep referenced from the Rhino model> x54, <curve referenced from the Rhino model> x2, <brep referenced from the Rhino model> x54, <curve referenced from the Rhino model> x2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])
geo_3 = Geometry(<brep referenced from the Rhino model>)
geo_4 = Geometry([<curve referenced from the Rhino model> x2, <brep referenced from the Rhino model> x64, <curve referenced from the Rhino model>, <brep referenced from the Rhino model> x5, <curve referenced from the Rhino model>, <brep referenced from the Rhino model> x5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])
geo_5 = Geometry([<brep referenced from the Rhino model> x114, <curve referenced from the Rhino model> x114, <brep referenced from the Rhino model>, <curve referenced from the Rhino model> x3, <brep referenced from the Rhino model> x16, <curve referenced from the Rhino model>, <brep referenced from the Rhino model> x2, <curve referenced from the Rhino model> x2])
geo_6 = Geometry([<curve referenced from the Rhino model> x2, <brep referenced from the Rhino model>])
geo_7 = Geometry(<brep referenced from the Rhino model>)
geo_8 = Geometry([<curve referenced from the Rhino model> x8, <brep referenced from the Rhino model> x8, <curve referenced from the Rhino model> x8, <brep referenced from the Rhino model> x8])
geo_9 = Geometry([<curve referenced from the Rhino model>, <brep referenced from the Rhino model>, <curve referenced from the Rhino model>, <brep referenced from the Rhino model>])
geo_10 = Geometry([<curve referenced from the Rhino model> x4, <brep referenced from the Rhino model> x3, <curve referenced from the Rhino model>, <brep referenced from the Rhino model> x2, <curve referenced from the Rhino model>, <brep referenced from the Rhino model> x3, <curve referenced from the Rhino model> x2, <brep referenced from the Rhino model> x11])
geo_11 = Geometry([<curve referenced from the Rhino model>, <brep referenced from the Rhino model>])
vgeo = VRayGeometry(Geo=geo, Material=mtl_name)
vgeo_2 = VRayGeometry(Geo=geo_2, Material=mtl_name_2)
vgeo_3 = VRayGeometry(Geo=geo_3, Material=mtl_name_3)
vgeo_4 = VRayGeometry(Geo=geo_4, Material=mtl_name_4)
vgeo_5 = VRayGeometry(Geo=geo_5, Material=mtl_name_5)
vgeo_6 = VRayGeometry(Geo=geo_6, Material=mtl_name_6)
vgeo_7 = VRayGeometry(Geo=geo_7, Material=mtl_name_7)
vgeo_8 = VRayGeometry(Geo=geo_8, Material=mtl_name_8)
vgeo_9 = VRayGeometry(Geo=geo_9, Material=mtl_name_9)
vgeo_10 = VRayGeometry(Geo=geo_10, Material=mtl_name_10)
vgeo_11 = VRayGeometry(Geo=geo_11, Material=mtl_name_11)
pt = Point(Point(8.125, 11.375, 0))
number_slider = Slider(300, range=0..1800)
python = GhPythonScript(center=pt, y=number_slider)  # -> out, curvePoints; inputs center: Point3d, y: Int32
# ---------- python: Python ----------
__author__ = "rah9eu"
__version__ = "2020.11.13"

import rhinoscriptsyntax as rs
import Rhino as rh
import math 

temp = []
 
rotationsUp = 2 #total number of times to rotate around the building
distanceFromCenter = 50
fin = 360 * rotationsUp
maxHeight = 193
offset = 15 #Handles that the center isn't the best point and I'm too lazy to just recreate the point every time
toReturn = []

for i in range(0,fin, 1):
    
    tempX = center.X + distanceFromCenter * math.sin(math.radians(i))
    tempZ = center.Z + distanceFromCenter * -1 * math.cos(math.radians(i))  +offset
    tempY = i/fin * maxHeight #scale i so that it is in terms of vertical height in meters
    temp.append(rs.CreatePoint(tempX, tempZ, tempY))
    #print("Point " + tempX + ", " + tempY + ", " + tempZ + " has been added to the  array")
#temp.remove(temp[-1])

#temp.append(rs.CreatePoint(center.X - distanceFromCenter + 2*offset, center.Z, maxHeight- (y/8)))
#temp.append(rs.CreatePoint(center.X, center.Z- distanceFromCenter/2, maxHeight))


curve = rs.AddCurve(temp)

dividedPoints = rs.DivideCurve(curve, y)
start = rs.CreatePoint(center.X, center.Y - 50 + 15, center.Z + 1.25)
#end = rs.CreatePoint(center.X, center.Y - 90 + 15, center.Z + 193)
curvePoints = []
#curvePoints.append(start)
curvePoints.extend(dividedPoints[1:])
#curvePoints.extend(temp)
#curvePoints.append(end)
# ---------- end python ----------
python_2 = GhPythonScript(dividedPoints=python.curvePoints, centerPoint=pt)  # -> out, targetPoints; inputs dividedPoints: list of Point3d, centerPoint: Point3d
# ---------- python_2: Python ----------
__author__ = "rah9eu"
__version__ = "2020.11.20"

import rhinoscriptsyntax as rs

X = centerPoint.X
Y = centerPoint.Y
targetPoints = []
for i in range(len(dividedPoints)):
    targetPoints.append(rs.CreatePoint(X,Y, dividedPoints[i].Z))
# ---------- end python_2 ----------
type = Type(
    0,
    Has_Extract_Parameter=False,
    Has_Manage_Collection=False,
    OptionsLength=4,
    Version=1,
    Options=["Standard", "Orthographic", "VR Spherical Panorama", "VR Cube Map"])
rig_sun = VRayLightRigSunSystem(
    SunOn=Toggle(True),
    SunPosition=Point(0.5, 0.5, 0.707),
    SunTarget=Point(0, 0, 0),
    SunIntensity=0.03,
    SunFilterColor=ColourSwatch(SwatchColor=RGB(255, 255, 255)),
    GroundColor=ColourSwatch(SwatchColor=RGB(112, 112, 112)))
number_slider_2 = Slider(2, range=0..10)
subtraction = Subtraction(A=number_slider, B=Slider(1, range=0..1))
timeline = VRayTimeline(FramesCount=number_slider, RangeStart=Slider(205, range=0..300), RangeEnd=subtraction)  # -> Timeline, CurrentFrame, CurrentFraction
item = ListItem(List=python.curvePoints, Index=timeline.CurrentFrame, Wrap=True)
item_2 = ListItem(List=python_2.targetPoints, Index=timeline.CurrentFrame, Wrap=True)
camera = VRayCamera(
    Type=type,
    Position=item,
    Target=item_2,
    FOV=62.84553146,
    Tilt=0,
    OrthographicZoomFactor=0,
    PhysicalExposureOn=Toggle(False),
    FNumber=8,
    ShutterSpeed1S=100,
    FilmSensitivity=625)  # -> Camera, Angle
sampler = Sampler(
    0,
    Has_Extract_Parameter=False,
    Has_Manage_Collection=False,
    OptionsLength=2,
    Version=1,
    Options=["Progressive", "Bucket"])
out_img = OutputImage(
    "\\Classes.arch.virginia.edu\CLASSES\ARCH2710-Mark-FAL2020\submit\T_TH330PM\Harris_Arthur\scratch\Exercise 6 Animation Rotate\Up.jpg",
    File_Picker=1,
    File_Types="Portable Network Graphics (*.png)|*.png|Windows bitmap (*.bmp)|*.bmp|Targa Image (*.tga)|*.tga|Radiance High-Dynamyc Range (*.hdr)|*.hdr|Silicon Graphics (*.sgi; *.rgb; *.rgba)|*.dgi;*.rgb;*.rgba|JPEG image (*.jpg; *.jpeg)|*.jpg;*.jpeg|OpenEXR image (*.exr)|*.exr|SoftImage PICT (*.pic)|*.pic|Tagged image (*.tif; *.tiff)|*.tif;*.tiff|V-Ray Raw Image (*.vrimg)|*.vrimg",
    Multiple_Files=False)
quality = Quality(
    3,
    Has_Extract_Parameter=False,
    Has_Manage_Collection=False,
    OptionsLength=6,
    Version=1,
    Options=["Low", "Low+", "Medium", "Medium+", "High", "High+"])
engine = Engine(2, Has_Extract_Parameter=False, Has_Manage_Collection=False, OptionsLength=3, Version=1, Options=["CPU", "CUDA", "RTX"])
mode = Mode(
    1,
    Has_Extract_Parameter=False,
    Has_Manage_Collection=False,
    OptionsLength=2,
    Version=1,
    Options=["Interactive", "Production"])
panel = Panel(out_img)
render = VRayRender(
    Engine=engine,
    Mode=mode,
    Sampler=sampler,
    Quality=quality,
    OutputImage=out_img,
    OutputResolution=[960, 540],
    Camera=camera.Camera,
    LightRig=rig_sun,
    VGeometry=flatten([vgeo, vgeo_2, vgeo_3, vgeo_4, vgeo_5, vgeo_6, vgeo_7, vgeo_8, vgeo_9, vgeo_10, vgeo_11]),
    Timeline=timeline.Timeline,
    UpdateEffectsFrequency=100)
