# Grasshopper definition Metalv6.gh (Grasshopper 1.0.7)

number_slider = Slider(56, range=2..100)
number_slider_2 = Slider(3.4, range=0..10)
crv = Curve(<curve referenced from the Rhino model>)
crv_2 = Curve(<curve referenced from the Rhino model>)
geo = Geometry([<brep referenced from the Rhino model> x2])
geo_2 = Geometry([<brep referenced from the Rhino model> x2])
division = Division(A=Slider(90, range=-90..90), B=number_slider)
multiplication = Multiplication(A=number_slider_2, B=Slider(6, range=0..10))
# Note that simply opening this script deletes the two objects with ObjDet elements, since they don't actually belong on the first floor of the building
objdet = ObjectDetails(Object=geo_2)  # -> Referenced, Available, Name, Layer, Colour, Guid
objdet_2 = ObjectDetails(Object=geo)  # -> Referenced, Available, Name, Layer, Colour, Guid
Z = UnitZ(Factor=crv_2)
Z_2 = UnitZ(Factor=1)
# Bake This Element...
python = GhPythonScript(
    constantIDs=objdet.Guid,
    constantMetal=geo_2,
    metalTrimIDs=objdet_2.Guid,
    metalTrim=geo,
    circle=crv,
    deltaAng=division,
    count=number_slider,
    axis=crv_2,
    deltaHeight0=number_slider_2,
    deltaHeight1=multiplication,
    v=Z_2,
    centerPointVector=Z)  # -> ConsistentTrim, BigTrim, SmallTrim; inputs constantIDs: list of Guid, circle: Curve, count: Int32, v: Vector3d
# ---------- python: Python ----------
__author__ = "Student"
__version__ = "2020.09.25"

import rhinoscriptsyntax as rs
import scriptcontext as sc
import Rhino as rh
import math as m
import ghpythonlib.components as ghcomp

trimConsistent = []
trimBig = []
trimSmall = []

bigHeight = 0
#hmetal = 0
#hingeAngle = 0
#trussAngle = 0
for i in range(0, count+1):
    r = deltaAng*i
    height = deltaHeight0 * i
    cpt = rs.CurveStartPoint(axis)

##Handling the circles to build the cylindrical piping
    circleHeight = deltaHeight0 * i
    curMetal = rs.RotateObject(circle, cpt, r, centerPointVector, copy=True)
    curTrans = circleHeight * v
    curMetal2 = rs.MoveObject(curMetal, curTrans)
    trimConsistent.append(curMetal2)

#Metal Support Portion

    if(i == 1):
        curMetalTrimCopy = rs.RotateObject(metalTrim, cpt, r, axis=centerPointVector, copy=True)
        curTrans = height * v
        curMetalTrim2 = rs.MoveObject(curMetalTrimCopy, curTrans)
        trimBig.append(curMetalTrim2)
    if(i>2 and (i-2)%6 == 0):
        curMetalTrimCopy = rs.RotateObject(metalTrim, cpt, r, axis=centerPointVector, copy=True)
        curTrans = height * v
        curMetalTrim2 = rs.MoveObject(curMetalTrimCopy, curTrans)
        trimBig.append(curMetalTrim2)
    if(i == 2):
        curMetalC = rs.RotateObject(constantMetal, cpt, r, centerPointVector, copy=True)
        curTrans = height * v
        curMetal2 = rs.MoveObject(curMetalC, curTrans)
        trimSmall.append(curMetal2)
    #if((i-2)%6 != 0 and not ((i == 1) or ((i-2)%6 == 0 and i> 2))):
    if((i-2)%6 and (i>1)):
        curMetalC = rs.RotateObject(constantMetal, cpt, r, centerPointVector, copy=True)
#        if(i < 10):
#            curTrans = (height- 0.7)* v
#        else:
#            curTrans = height * 
        curTrans = height * v
        curMetal2 = rs.MoveObject(curMetalC, curTrans)
        trimSmall.append(curMetal2)

ConsistentTrim = trimConsistent
BigTrim = trimBig
SmallTrim = trimSmall

sc.doc = rh.RhinoDoc.ActiveDoc #DON'T UNCOMMENT until ready run
rs.DeleteObjects(constantIDs)
rs.DeleteObjects(metalTrimIDs)
sc.doc = ghdoc
# ---------- end python ----------
loft = Loft(
    Curves=python.ConsistentTrim,
    Options={Adjust=False, Closed=False, LoftEnds=0, LoftSimp=0, LoftType=0, Rebuild=10, Refit=0.01})
panel = Panel("And this Element")
cap = CapHoles(Brep=loft)
