# Grasshopper definition TorsoRotation.gh (Grasshopper 1.0.7)

number_slider = Slider(56, range=2..100)
geo = Geometry([<brep referenced from the Rhino model> x104, <curve referenced from the Rhino model> x3])
geo_2 = Geometry([<brep referenced from the Rhino model> x18, <curve referenced from the Rhino model> x8, <brep referenced from the Rhino model> x2, <curve referenced from the Rhino model> x6, <brep referenced from the Rhino model> x3, <curve referenced from the Rhino model>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])
geo_3 = Geometry([<brep referenced from the Rhino model> x41, <curve referenced from the Rhino model> x3])
geo_4 = Geometry([<brep referenced from the Rhino model>, <curve referenced from the Rhino model>, <brep referenced from the Rhino model> x2, <curve referenced from the Rhino model>, <brep referenced from the Rhino model> x3, <curve referenced from the Rhino model> x4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])
geo_5 = Geometry([<brep referenced from the Rhino model>, <curve referenced from the Rhino model> x5, <brep referenced from the Rhino model> x41])
geo_6 = Geometry([<brep referenced from the Rhino model> x2, <curve referenced from the Rhino model> x2, <brep referenced from the Rhino model>, <curve referenced from the Rhino model>, <brep referenced from the Rhino model> x2, <curve referenced from the Rhino model> x3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])
crv = Curve(<curve referenced from the Rhino model>)
objdet = ObjectDetails(Object=geo_4)  # -> Referenced, Available, Name, Layer, Colour, Guid
Z = UnitZ(Factor=1)
objdet_2 = ObjectDetails(Object=geo_6)  # -> Referenced, Available, Name, Layer, Colour, Guid
objdet_3 = ObjectDetails(Object=geo_3)  # -> Referenced, Available, Name, Layer, Colour, Guid
objdet_4 = ObjectDetails(Object=geo_5)  # -> Referenced, Available, Name, Layer, Colour, Guid
objdet_5 = ObjectDetails(Object=geo_2)  # -> Referenced, Available, Name, Layer, Colour, Guid
division = Division(A=Slider(90, range=-90..90), B=number_slider)
objdet_6 = ObjectDetails(Object=geo)  # -> Referenced, Available, Name, Layer, Colour, Guid
python = GhPythonScript(
    defaultWinIDs=objdet_6.Guid,
    windowInputDefault=geo,
    defaultWallIDs=objdet_5.Guid,
    wallsDefault=geo_2,
    circWinIDs=objdet_3.Guid,
    windowsCircular=geo_3,
    circWallIDs=objdet.Guid,
    wallsCircular=geo_4,
    baseWinIDs=objdet_4.Guid,
    windowBase=geo_5,
    baseWallIDs=objdet_2.Guid,
    wallsBase=geo_6,
    axis=crv,
    count=number_slider,
    deltaAng=division,
    deltaHeightFloor=Slider(3.4, range=0..10),
    v=Z)  # -> out, windows, a; inputs defaultWinIDs: list, axis: Curve, count: Int32, v: Vector3d
# ---------- python: Python ----------
__author__ = "Arthur Harris (rah9eu)"
__version__ = "2020.09.25"

import rhinoscriptsyntax as rs
import scriptcontext as sc
import Rhino as rh
import math as m

floorArray = []
#metal = []
windowsArray = []
hmain = 0
#hmetal = 0
for i in range(count):
#Main Structure (Torso) Portion
    hmain = i*deltaHeightFloor
    r =  i*deltaAng 
    cpt = rs.CurveStartPoint(axis)
#    if(i == 0):
#        continue
    if(i in {0,1}):
        curRec = rs.RotateObject(wallsBase,cpt, r, v, copy=True)
        curTrans = hmain * v
        curRec2 = rs.MoveObject(curRec, curTrans)
        floorArray.append(curRec2)
        curWin = rs.RotateObject(windowBase,cpt, r, v, copy=True)
        curTransWin = hmain * v
        curWin2 = rs.MoveObject(curWin, curTransWin)
        windowsArray.append(curWin2)
    elif((i-2)%6 == 0 and i > 5):
        curRec = rs.RotateObject(wallsCircular,cpt, r, v, copy=True)
        curTrans = hmain * v
        curRec2 = rs.MoveObject(curRec, curTrans)
        floorArray.append(curRec2)
        curWin = rs.RotateObject(windowsCircular,cpt, r, v, copy=True)
        curTransWin = hmain * v
        curWin2 = rs.MoveObject(curWin, curTransWin)
        windowsArray.append(curWin2)
    else:
        curRec = rs.RotateObject(wallsDefault,cpt, r, v, copy=True)
        curTrans = hmain * v
        curRec2 = rs.MoveObject(curRec, curTrans)
        floorArray.append(curRec2)
        curRec = rs.RotateObject(windowInputDefault,cpt, r, v, copy=True)
        curTrans = hmain * v
        curRec2 = rs.MoveObject(curRec, curTrans)
        windowsArray.append(curRec2)

a = floorArray
windows = windowsArray

#Uncommenting these two lines will delete the input, fully finishing the model

#sc.doc = rh.RhinoDoc.ActiveDoc
rs.DeleteObjects(defaultWinIDs)
rs.DeleteObjects(defaultWallIDs)
rs.DeleteObjects(circWinIDs)
rs.DeleteObjects(circWallIDs)
rs.DeleteObjects(baseWinIDs)
rs.DeleteObjects(baseWallIDs)
#sc.doc = ghdoc
# ---------- end python ----------
